# Dynamo graph 01_Operaciones con tipos de datos.dyn (Dynamo 2.0.3.8810)

# group: String
string = StringInput("Renzo Rios")
code_block = CodeBlock { "Renzo Rios"; }

# group: Number
number = DoubleInput(15)
number_slider = DoubleSlider(9.2, range=0..100 step 0.1)
code_block_2 = CodeBlock { 9.2; }

# group: Booleano
boolean = BoolSelector(false)
code_block_3 = CodeBlock { true; }
code_block_4 = CodeBlock { false; }

# group: Suma de Numeros
code_block_5 = CodeBlock { 25; }
code_block_6 = CodeBlock { 30; }
code_block_7 = CodeBlock(a=code_block_5, b=code_block_6) { a+b; }
watch = Watch(code_block_7)

# group: Suma de number y string
code_block_8 = CodeBlock { "Renzo Rios tiene "; }
code_block_9 = CodeBlock { 27; }
code_block_10 = CodeBlock { " años"; }
saludo = CodeBlock(nombre=code_block_8, edad=code_block_9, años=code_block_10) { "Hola,"+nombre+edad+años; }
watch_2 = Watch(saludo)

# group: String + Booleano
code_block_11 = CodeBlock { "Renzo Rios: "; }
code_block_12 = CodeBlock { true; }
code_block_13 = CodeBlock(a=code_block_11, b=code_block_12) { a+b; }

# group: Number + boolean
code_block_14 = CodeBlock { 0; }
code_block_15 = CodeBlock { true; }
code_block_16 = CodeBlock(a=code_block_14, b=code_block_15) { a+b; }

# group: String + Number
code_block_17 = CodeBlock { "15"; }
toNumber = String.ToNumber(str=code_block_17)
code_block_18 = CodeBlock { 20; }
code_block_19 = CodeBlock(a=toNumber, b=code_block_18) { a*b; }
