# Dynamo graph 02_Informacion de Elementos.dyn (Dynamo 2.0.3.8810)

# group: Obtner elementos
family_types = FamilyTypes(index=35)
all_elements_of_family_type = ElementsOfFamilyType(Family_Type=family_types)

parameters = Element.Parameters(element=all_elements_of_family_type)

# group: Obtner informacion
code_block = CodeBlock { "Volume"; }
getParameterValueByName = Element.GetParameterValueByName(element=all_elements_of_family_type, parameterName=code_block)
code_block_2 = CodeBlock { "Length"; }
getParameterValueByName_2 = Element.GetParameterValueByName(element=all_elements_of_family_type, parameterName=code_block_2)

operacion_suma = getParameterValueByName + getParameterValueByName_2
