# Dynamo graph 03_Mascara Booleana.dyn (Dynamo 2.0.3.8810)

# group: Obtener todos los elementos por categoria
categories = Categories(index=604)
all_elements_of_category = ElementsOfCategory(Category=categories)

parameters = Element.Parameters(element=all_elements_of_category)

# group: Filtro de elementos mayores a 6 m
code_block = CodeBlock { "Length"; }
getParameterValueByName = Element.GetParameterValueByName(element=all_elements_of_category, parameterName=code_block)
code_block_2 = CodeBlock { 6; }
ge = getParameterValueByName >= code_block_2
filterByBoolMask = List.FilterByBoolMask(list=all_elements_of_category, mask=ge)

# group: No cumplen
watch = Watch(filterByBoolMask.out)
code_block_3 = CodeBlock { "Length"; }
getParameterValueByName_2 = Element.GetParameterValueByName(element=watch, parameterName=code_block_3)

# group: Cumplen
watch_2 = Watch(filterByBoolMask.in)
code_block_4 = CodeBlock { "Length"; }
getParameterValueByName_3 = Element.GetParameterValueByName(element=watch_2, parameterName=code_block_4)
