# Dynamo graph 04_Mascara Booleana Texto - Operaciones.dyn (Dynamo 2.0.3.8810)

# group: Obtener todos los elementos por categoria
categories = Categories(index=604)
all_elements_of_category = ElementsOfCategory(Category=categories)

parameters = Element.Parameters(element=all_elements_of_category)

# group: Muro 01
code_block = CodeBlock { "Tipo Muro"; }
getParameterValueByName = Element.GetParameterValueByName(element=all_elements_of_category, parameterName=code_block)
code_block_2 = CodeBlock { "Muro 01"; }
eq = getParameterValueByName == code_block_2
filterByBoolMask = List.FilterByBoolMask(list=all_elements_of_category, mask=eq)

# group: Mayores a 6m
code_block_3 = CodeBlock { "Length"; }
getParameterValueByName_2 = Element.GetParameterValueByName(element=filterByBoolMask.in, parameterName=code_block_3)
code_block_4 = CodeBlock { 6; }
ge = getParameterValueByName_2 >= code_block_4
filterByBoolMask_2 = List.FilterByBoolMask(list=filterByBoolMask.in, mask=ge)

# group: Suma de longitud tipo 01 y mayores a 6m
code_block_5 = CodeBlock { "Length"; }
getParameterValueByName_3 = Element.GetParameterValueByName(element=filterByBoolMask_2.in, parameterName=code_block_5)
sum = Math.Sum(values=getParameterValueByName_3)

# group: Muro 02
code_block_6 = CodeBlock { "Tipo Muro"; }
getParameterValueByName_4 = Element.GetParameterValueByName(element=all_elements_of_category, parameterName=code_block_6)
code_block_7 = CodeBlock { "Muro 02"; }
eq_2 = getParameterValueByName_4 == code_block_7
filterByBoolMask_3 = List.FilterByBoolMask(list=all_elements_of_category, mask=eq_2)

# group: Suma de Longitud tipo 02
code_block_8 = CodeBlock { "Length"; }
getParameterValueByName_5 = Element.GetParameterValueByName(element=filterByBoolMask_3.in, parameterName=code_block_8)
sum_2 = Math.Sum(values=getParameterValueByName_5)

# group: Muro 03
code_block_9 = CodeBlock { "Tipo Muro"; }
getParameterValueByName_6 = Element.GetParameterValueByName(element=all_elements_of_category, parameterName=code_block_9)
code_block_10 = CodeBlock { "Muro 03"; }
eq_3 = getParameterValueByName_6 == code_block_10
filterByBoolMask_4 = List.FilterByBoolMask(list=all_elements_of_category, mask=eq_3)

# group: Suma de Longitud tipo 03
code_block_11 = CodeBlock { "Length"; }
getParameterValueByName_7 = Element.GetParameterValueByName(element=filterByBoolMask_4.in, parameterName=code_block_11)
sum_3 = Math.Sum(values=getParameterValueByName_7)

# group: Sin asignar
code_block_12 = CodeBlock { "Tipo Muro"; }
getParameterValueByName_8 = Element.GetParameterValueByName(element=all_elements_of_category, parameterName=code_block_12)
code_block_13 = CodeBlock { ""; }
eq_4 = getParameterValueByName_8 == code_block_13
filterByBoolMask_5 = List.FilterByBoolMask(list=all_elements_of_category, mask=eq_4)
