# Dynamo graph 05_Obtener Parametro tipo.dyn (Dynamo 2.0.3.8810)

# group: Obtener elementos por categoria
categories = Categories(index=604)
all_elements_of_category = ElementsOfCategory(Category=categories)

parameters = Element.Parameters(element=all_elements_of_category)

# group: Parametro tipo
code_block = CodeBlock { "Type"; }
getParameterValueByName = Element.GetParameterValueByName(element=all_elements_of_category, parameterName=code_block)
parameters_2 = Element.Parameters(element=getParameterValueByName)

code_block_2 = CodeBlock { "Width"; }
getParameterValueByName_2 = Element.GetParameterValueByName(element=getParameterValueByName, parameterName=code_block_2)
