# Dynamo graph 06_Guardar Informacion en Parametros.dyn (Dynamo 2.0.3.8810)

# group: Enumerar Arboles
categories = Categories(index=358)
all_elements_of_category = ElementsOfCategory(Category=categories)
code_block = CodeBlock { "Mark"; }
count = List.Count(list=all_elements_of_category)
code_block_2 = CodeBlock(x=count) { 1..x; }
code_block_3 = CodeBlock(numero=code_block_2) { "R_" + numero; }
setParameterByName = Element.SetParameterByName(element=all_elements_of_category, parameterName=code_block, value=code_block_3)

# group: Doble de Area
categories_2 = Categories(index=604)
all_elements_of_category_2 = ElementsOfCategory(Category=categories_2)
code_block_4 = CodeBlock { "Comments"; }
code_block_5 = CodeBlock { "Area"; }
getParameterValueByName = Element.GetParameterValueByName(element=all_elements_of_category_2, parameterName=code_block_5)
pintura = CodeBlock(area=getParameterValueByName) { 2*area; }
string_from_object = FromObject(obj=pintura)
setParameterByName_2 = Element.SetParameterByName(element=all_elements_of_category_2, parameterName=code_block_4, value=string_from_object)
