# Dynamo graph 00_Comparando tipos.dyn (Dynamo 2.0.3.8810)

# group: Convertir el type a string y compararlo
categories = Categories(index=604)
all_elements_of_category = ElementsOfCategory(Category=categories)
parameters = Element.Parameters(element=all_elements_of_category)
code_block = CodeBlock { "Type"; }
getParameterValueByName = Element.GetParameterValueByName(element=all_elements_of_category, parameterName=code_block)
string_from_object = FromObject(obj=getParameterValueByName)
code_block_2 = CodeBlock { "SIP 202mm Wall - conc clad"; }
eq = string_from_object == code_block_2
filterByBoolMask = List.FilterByBoolMask(list=getParameterValueByName, mask=eq)

# group: Obtener el Type Name y compararlo
categories_2 = Categories(index=604)
all_elements_of_category_2 = ElementsOfCategory(Category=categories_2)
parameters_2 = Element.Parameters(element=all_elements_of_category_2)
code_block_3 = CodeBlock { "Type"; }
getParameterValueByName_2 = Element.GetParameterValueByName(element=all_elements_of_category_2, parameterName=code_block_3)
code_block_4 = CodeBlock { "Type Name"; }
getParameterValueByName_3 = Element.GetParameterValueByName(element=getParameterValueByName_2, parameterName=code_block_4)
code_block_5 = CodeBlock { "SIP 202mm Wall - conc clad"; }
eq_2 = getParameterValueByName_3 == code_block_5
filterByBoolMask_2 = List.FilterByBoolMask(list=getParameterValueByName_2, mask=eq_2)

# group: No se puede comparar objectos con ==
categories_3 = Categories(index=604)
all_elements_of_category_3 = ElementsOfCategory(Category=categories_3)
parameters_3 = Element.Parameters(element=all_elements_of_category_3)
code_block_6 = CodeBlock { "Type"; }
getParameterValueByName_4 = Element.GetParameterValueByName(element=all_elements_of_category_3, parameterName=code_block_6)
string_from_object_2 = FromObject(obj=getParameterValueByName_4)
wall_types = WallTypes(index=10)
string_from_object_3 = FromObject(obj=wall_types)
eq_3 = string_from_object_2 == string_from_object_3
filterByBoolMask_3 = List.FilterByBoolMask(list=getParameterValueByName_4, mask=eq_3)

# group: Comparando Objectos
categories_4 = Categories(index=604)
all_elements_of_category_4 = ElementsOfCategory(Category=categories_4)
code_block_7 = CodeBlock { "Type"; }
getParameterValueByName_5 = Element.GetParameterValueByName(element=all_elements_of_category_4, parameterName=code_block_7)
wall_types_2 = WallTypes(index=10)
equals = List.Equals(objectA=getParameterValueByName_5, objectB=wall_types_2, lacing=Longest)
filterByBoolMask_4 = List.FilterByBoolMask(list=getParameterValueByName_5, mask=equals)
parameters_4 = Element.Parameters(element=all_elements_of_category_4)

# group: Comparando Niveles
categories_5 = Categories(index=604)
all_elements_of_category_5 = ElementsOfCategory(Category=categories_5)
code_block_8 = CodeBlock { "Base Constraint"; }
getParameterValueByName_6 = Element.GetParameterValueByName(element=all_elements_of_category_5, parameterName=code_block_8)
levels = Levels(index=4)
equals_2 = List.Equals(objectA=getParameterValueByName_6, objectB=levels, lacing=Longest)
filterByBoolMask_5 = List.FilterByBoolMask(list=getParameterValueByName_6, mask=equals_2)
parameters_5 = Element.Parameters(element=all_elements_of_category_5)
parameters_6 = Element.Parameters(element=all_elements_of_category_5)
