# Dynamo graph 01_Reporte de Categorias.dyn (Dynamo 2.0.3.8810)

all_elements_in_active_view = ElementsInView()
getCategory = Element.GetCategory(element=all_elements_in_active_view)  # frozen
code_block = CodeBlock { "03-03-2020"; }
categoryName = Elements.Element.CategoryName(element=all_elements_in_active_view)
uniqueItems = List.UniqueItems(list=categoryName)
categoryName_2 = Elements.Element.CategoryName()  # unwired: element
groupByFunction = List.GroupByFunction(list=all_elements_in_active_view, func=categoryName_2)
count = List.Count(list=groupByFunction, lacing=Longest)
code_block_2 = CodeBlock(fecha=code_block, categoria=uniqueItems, cantidad=count)
# ---------- code_block_2.designscript (4 lines) ----------
"######REPORTE DE CATEGORIAS DENTRO DEL PROYECTO####";
"Fecha: " + fecha;
"Categorias del Proyecto";
categoria + ": " + cantidad + " elementos";
# ----------------------------------------
list_create = List.Create(item0=code_block_2.out0, item1=code_block_2.out1, item2=code_block_2.out2, item3=code_block_2.out3)
watch = Watch(list_create)
flatten = List.Flatten(list=watch)
listToStringLines = Strings.String.listToStringLines(elements=flatten)
watch_2 = Watch(listToStringLines)
directory_path = Directory("D:\Usuarios\rrios\Escritorio")
code_block_3 = CodeBlock(ruta=directory_path, fecha=code_block) { ruta + "\\" + "Reporte " + fecha + ".txt"; }
writeText = FileSystem.WriteText(filePath=code_block_3, text=listToStringLines)
