# Dynamo graph 02_Exportar Informacion a Excel.dyn (Dynamo 2.0.3.8810)

# group: Obtener Elementos
categories = Categories(index=506)
all_elements_of_category = ElementsOfCategory(Category=categories)

parameters = Element.Parameters(element=all_elements_of_category)

# group: Gestionar informacion
id = Element.Id(element=all_elements_of_category)
code_block = CodeBlock { "Type"; }
getParameterValueByName = Element.GetParameterValueByName(element=all_elements_of_category, parameterName=code_block)
string_from_object = FromObject(obj=getParameterValueByName)
code_block_2 = CodeBlock { "Length"; }
getParameterValueByName_2 = Element.GetParameterValueByName(element=all_elements_of_category, parameterName=code_block_2)
code_block_3 = CodeBlock { "Volume"; }
getParameterValueByName_3 = Element.GetParameterValueByName(element=all_elements_of_category, parameterName=code_block_3)

list_create = List.Create(item0=id, item1=string_from_object, item2=getParameterValueByName_2, item3=getParameterValueByName_3)

# group: Exportar a Excel
file_path = Filename("D:\Usuarios\rrios\Escritorio\Metrado_Muros.xlsx")
code_block_4 = CodeBlock { "Columnas"; }
code_block_5 = CodeBlock { 3; }
code_block_6 = CodeBlock { 1; }
transpose = List.Transpose(lists=list_create)
exportExcel = Data.ExportExcel(filePath=file_path, sheetName=code_block_4, startRow=code_block_5, startCol=code_block_6, data=transpose)
