# Dynamo graph 03_Familia por Punto.dyn (Dynamo 2.0.3.8810)

select_model_elements = DSModelElementsSelection()  # 9 picked in the model
getLocation = Element.GetLocation(element=select_model_elements)
Z = Point.Z(point=getLocation)
family_types = FamilyTypes(index=35)
byPoint = FamilyInstance.ByPoint(familyType=family_types, point=getLocation)
X = Point.X(point=getLocation)
Y = Point.Y(point=getLocation)
code_block = CodeBlock { 2.10; }
byCoordinates = Point.ByCoordinates(x=X, y=Y, z=code_block)
