# Dynamo graph 01_Muro por curvas.dyn (Dynamo 2.0.3.8810)

select_model_elements = DSModelElementsSelection()  # 4 picked in the model
curves = Element.Curves(element=select_model_elements)
code_block = CodeBlock { 2.3; }
levels = Levels(index=2)
wall_types = WallTypes(index=10)
byCurveAndHeight = Wall.ByCurveAndHeight(curve=curves, height=code_block, level=levels, wallType=wall_types)
select_model_element = DSModelElementSelection()  # 1 picked in the model
