# Dynamo graph 02_Tuberias por Curvas.dyn (Dynamo 2.0.3.8810)

# group: Curvas
select_model_elements = DSModelElementsSelection()  # 3 picked in the model
curves = Element.Curves(element=select_model_elements)

# group: Informacion de Tuberias
nameCollector = Elements.PipingSystemType.NameCollector()
code_block = CodeBlock(SistemaTipo=nameCollector) { SistemaTipo[2]; }
byName = Elements.PipingSystemType.ByName(name=code_block)
nameCollector_2 = Elements.PipeType.NameCollector()
code_block_2 = CodeBlock(Tipo=nameCollector_2) { Tipo[0]; }
byName_2 = Elements.PipeType.ByName(name=code_block_2)
levels = Levels(index=4)

byCurve = Elements.Pipe.ByCurve(curve=curves, pipingSystemType=byName, pipeType=byName_2, level=levels)
