# Dynamo graph 03_Id Element.dyn (Dynamo 2.0.3.8810)

categories = Categories(index=604)
all_elements_of_category = ElementsOfCategory(Category=categories)
code_block = CodeBlock { "Comments"; }
id = Element.Id(element=all_elements_of_category)
string_from_object = FromObject(obj=id)
setParameterByName = Element.SetParameterByName(element=all_elements_of_category, parameterName=code_block, value=string_from_object)
