# Dynamo graph 04_Importar Informacion de Excel.dyn (Dynamo 2.0.3.8810)

# group: Obtener Elementos
categories = Categories(index=604)
all_elements_of_category = ElementsOfCategory(Category=categories)
parameters = Element.Parameters(element=all_elements_of_category)  # frozen

# group: Obtner informacion
id = Element.Id(element=all_elements_of_category)
code_block = CodeBlock { "Unconnected Height"; }
getParameterValueByName = Element.GetParameterValueByName(element=all_elements_of_category, parameterName=code_block)
code_block_2 = CodeBlock { "Comments"; }
getParameterValueByName_2 = Element.GetParameterValueByName(element=all_elements_of_category, parameterName=code_block_2)

# group: Orden de informacion
list_create = List.Create(item0=id, item1=getParameterValueByName, item2=getParameterValueByName_2)
transpose = List.Transpose(lists=list_create)

# group: Exportar a Excel
file_path = Filename("D:\Usuarios\rrios\Escritorio\Metrados.xlsx")
code_block_3 = CodeBlock { "MetradoMuros"; }
code_block_4 = CodeBlock { 2; }
code_block_5 = CodeBlock { 1; }
exportExcel = Data.ExportExcel(filePath=file_path, sheetName=code_block_3, startRow=code_block_4, startCol=code_block_5, data=transpose)

# group: Obtener informacion
file_path_2 = Filename("D:\Usuarios\rrios\Escritorio\Metrados.xlsx")
file_from_path = FileObject(path=file_path_2)
code_block_6 = CodeBlock { "MetradoMuros"; }
importExcel = Data.ImportExcel(file=file_from_path, sheetName=code_block_6)

# group: Ordenar informacion
code_block_7 = CodeBlock { 1; }
dropItems = List.DropItems(list=importExcel, amount=code_block_7)
transpose_2 = List.Transpose(lists=dropItems)
code_block_8 = CodeBlock(Costo=transpose_2) { Costo[3]; }
string_from_object = FromObject(obj=code_block_8)

# group: Setear informacion
code_block_9 = CodeBlock { "Costito"; }
setParameterByName = Element.SetParameterByName(element=all_elements_of_category, parameterName=code_block_9, value=string_from_object)
