# Dynamo graph 06_Isolate Element.dyn (Dynamo 2.0.3.8810)

# group: Obtener Elementos
categories = Categories(index=604)
all_elements_of_category = ElementsOfCategory(Category=categories)

# group: Filtro de por longitud
code_block = CodeBlock { "Length"; }
getParameterValueByName = Element.GetParameterValueByName(element=all_elements_of_category, parameterName=code_block)
code_block_2 = CodeBlock { 5; }
ge = getParameterValueByName >= code_block_2
filterByBoolMask = List.FilterByBoolMask(list=all_elements_of_category, mask=ge)

# group: Coloreamos por RGB
code_block_3 = CodeBlock { 0; }
code_block_4 = CodeBlock { 255; }
byARGB = Color.ByARGB(r=code_block_3, g=code_block_4, b=code_block_4)
overrideColorInView = Element.OverrideColorInView(element=filterByBoolMask.in, color=byARGB)

color_palette = ColorPalette({R: 65, G: 105, B: 225, A: 255})

# group: Coloreamos por RGB
code_block_5 = CodeBlock { 255; 112; 53; }
byARGB_2 = Color.ByARGB(r=code_block_5.out0, g=code_block_5.out1, b=code_block_5.out2)
overrideColorInView_2 = Element.OverrideColorInView(element=filterByBoolMask.out, color=color_palette)
