# Dynamo graph 01_DP_ColorByLength.dyn (Dynamo 1.3.3.4111)

# group: Recoleccion de Elementos
# note: NOTAS DE DYNAMO PLAYER
# 1. Hay problemas con la version 2.0.3, por lo tanto es necesario trabajar con la version 1.3.3
# 2. Los Code Block no funcionan como inputs, por lo tanto trabajar con String o number
categories = Categories("Walls")
all_elements_of_category = ElementsOfCategory(categories)

# group: Filtro
code_block = CodeBlock { "Length"; }
getParameterValueByName = Element.GetParameterValueByName(element=all_elements_of_category, parameterName=code_block)
longitud_maxima = DoubleInput(7)
ge = getParameterValueByName >= longitud_maxima
filterByBoolMask = List.FilterByBoolMask(list=all_elements_of_category, mask=ge)

# group: Especificar colores por RGB
rojo = DoubleSlider(1, range=0..255 step 1)
verde = DoubleSlider(1, range=0..255 step 1)
azul = DoubleSlider(1, range=0..255 step 1)
byARGB = Color.ByARGB(r=rojo, g=verde, b=azul)

overrideColorInView = Element.OverrideColorInView(element=filterByBoolMask.in, color=byARGB)
