# Dynamo graph 02_DP_ColorTipo.dyn (Dynamo 1.3.3.4111)

# group: Elementos
categories = Categories("Walls")
all_elements_of_category = ElementsOfCategory(categories)
parameters = Element.Parameters(all_elements_of_category)

# group: Filtro
code_block = CodeBlock { "Tipo Muro"; }
getParameterValueByName = Element.GetParameterValueByName(element=all_elements_of_category, parameterName=code_block)
tipo_de_muro = StringInput("Tipo 01")
eq = getParameterValueByName == tipo_de_muro
filterByBoolMask = List.FilterByBoolMask(list=all_elements_of_category, mask=eq)

# group: Rando Number
code_block_2 = CodeBlock { 1; 255; }
random = Math.Random(code_block_2.out0, code_block_2.out1)
floor = Math.Floor(random)

# group: Rando Number
code_block_3 = CodeBlock { 1; 255; }
random_2 = Math.Random(code_block_3.out0, code_block_3.out1)
floor_2 = Math.Floor(random_2)

# group: Rando Number
code_block_4 = CodeBlock { 1; 255; }
random_3 = Math.Random(code_block_4.out0, code_block_4.out1)
floor_3 = Math.Floor(random_3)

byARGB = Color.ByARGB(r=floor, g=floor_2, b=floor_3)
overrideColorInView = Element.OverrideColorInView(element=filterByBoolMask.in, color=byARGB)

# group: Condicional
boolean = BoolSelector(false)
code_block_5 = CodeBlock { null; }
if_ = If(test=boolean, true=filterByBoolMask.out, false=code_block_5)

# group: Color Rojo
code_block_6 = CodeBlock { 225; }
byARGB_2 = Color.ByARGB(r=code_block_6)

overrideColorInView_2 = Element.OverrideColorInView(element=if_, color=byARGB_2)
