# Dynamo custom node 03_GetElementsByCategoryAndParameterValue.dyf (Dynamo 1.3.3.4111)
# category: Automatizacion03
# Obtiene los elementos de una categoria por el valo de un parametro

# group: Inputs
categoria = Input()
parametro = Input()
valor = Input()

# group: Logica
all_elements_of_category = ElementsOfCategory(categoria)
getParameterValueByName = Element.GetParameterValueByName(element=all_elements_of_category, parameterName=parametro)
eq = getParameterValueByName == valor
filterByBoolMask = List.FilterByBoolMask(list=all_elements_of_category, mask=eq)

# group: Outputs
elementos = Output(filterByBoolMask.in)
